# Grasshopper definition data-generator.gh (Grasshopper 1.0.8)
# plug-ins: LunchBox

vector_xyz = VectorXYZ(XComponent=0, YComponent=0, ZComponent=0)  # -> Vector, Length
point = Point(vector_xyz.Vector)
number_slider = Slider(1000, range=0..1000)
number_slider_2 = Slider(1300, range=1000..1300)
rectangle = Rectangle(Plane=point, XSize=number_slider, YSize=number_slider, Radius=0)  # -> Rectangle, Length
random_quad_panels = RandomQuadPanels(
    Surface=rectangle.Rectangle,
    UDivisions=Slider(15, range=0..100),
    VDivisions=Slider(70, range=0..100),
    RandomSeed=number_slider_2)
populate_2d = Populate2D(Region=rectangle.Rectangle, Count=Slider(250, range=0..1000), Seed=number_slider_2)
construct_domain = ConstructDomain(DomainStart=Slider(0.55, range=0..1), DomainEnd=Slider(0.95, range=0..1))
voronoi = Voronoi(Points=populate_2d, Boundary=rectangle.Rectangle, BruteForceOverride=False)
list_length = ListLength(List=random_quad_panels)
random = Random(Range=construct_domain, Number=1, Seed=number_slider_2)
multiplication = Multiplication(A=list_length, B=random)
random_reduce = RandomReduce(List=random_quad_panels, Reduction=multiplication, Seed=number_slider_2)
construct_domain_2 = ConstructDomain(DomainStart=Slider(60, range=0..100), DomainEnd=Slider(250, range=0..1000))
construct_domain_3 = ConstructDomain(DomainStart=Slider(20, range=0..100), DomainEnd=Slider(60, range=0..1000))
construct_domain_4 = ConstructDomain(DomainStart=Slider(5, range=0..100), DomainEnd=Slider(20, range=0..1000))
list_length_2 = ListLength(List=random_reduce)
boundary_surfaces = BoundarySurfaces(Edges=rectangle.Rectangle)
python_3_script = Python3Script(x=number_slider_2, L=construct_domain_4, M=construct_domain_3, H=construct_domain_2)  # -> out
# ---------- python_3_script: Python ----------
if x <= 200:
    print(L)
elif 200 < x <= 400:
    print(M)
elif x > 400:
    print(H)
# ---------- end python_3_script ----------
random_2 = Random(Range=python_3_script, Number=list_length_2, Seed=number_slider_2)
integer = Integer(random_2)
unit_z = UnitZ(Factor=integer)
extrude = Extrude(Base=random_reduce, Direction=unit_z)
cap_holes = CapHoles(Brep=extrude)
mesh_brep = MeshBrep(
    Brep=cap_holes,
    Settings={GridMaxCount=0, GridMinCount=16, JaggedSeams=False, MaxEdgeLength=0, MinEdgeLength=0.0001, MinTolerance=0, Refine=True, RefineAngle=0, RelativeTolerance=0.65, SimplePlanes=True, Tolerance=0})  # -> flatten(Mesh); disabled
mesh_join = MeshJoin(Meshes=mesh_brep)  # disabled
panel = Panel("https://climate.onebuilding.org/WMO_Region_4_North_and_Central_America/CAN_Canada/ON_Ontario/CAN_ON_Toronto-Pearson.Intl.AP.716240_TMYx.zip")
epwmap = LBEPWmap(epw_map=Toggle(False))  # -> Output; plug-in component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
deconstruct_mesh = DeconstructMesh(Mesh=mesh_join)  # -> Vertices, Faces, Colours, Normals; disabled
number_slider_3 = Slider(12, range=0..100)
number_slider_4 = Slider(21, range=0..100)
downloadepw = LBDownloadWeather(weather_URL=panel)  # -> epw_file, stat_file, ddy_file; plug-in component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
number_slider_5 = Slider(255, range=0..1000)  # disabled
number_slider_6 = Slider(50, range=0..100)  # disabled
number_slider_7 = Slider(0, range=0..100)  # disabled
number_slider_8 = Slider(250, range=0..1000)  # disabled
deconstruct = Deconstruct(Point=deconstruct_mesh.Vertices)  # -> XComponent, YComponent, ZComponent; disabled
importepw = LBImportEPW(epw_file=downloadepw.epw_file)  # -> location, dry_bulb_temperature, dew_point_temperature, relative_humidity, wind_speed, wind_direction, direct_normal_rad, diffuse_horizontal_rad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; plug-in component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
analysisperiod = LBAnalysisPeriod(
    start_month=number_slider_3,
    start_day=number_slider_4,
    start_hour=Slider(8, range=0..10),
    end_month=number_slider_3,
    end_day=number_slider_4,
    end_hour=Slider(16, range=0..100),
    timestep=Slider(1, range=0..1))  # -> period, hoys, dates; plug-in component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
construct_domain_5 = ConstructDomain(DomainStart=number_slider_6, DomainEnd=number_slider_5)  # disabled
construct_domain_6 = ConstructDomain(DomainStart=number_slider_7, DomainEnd=number_slider_8)  # disabled
number_slider_9 = Slider(0, range=0..100)  # disabled
number_slider_10 = Slider(255, range=0..1000)  # disabled
remap_numbers = RemapNumbers(Value=deconstruct.ZComponent, Source=construct_domain_6, Target=construct_domain_5)  # -> Mapped, Clipped; disabled
sunpath = LBSunPath(location=importepw.location, hoys=analysisperiod.hoys, scale=1)  # -> out, vectors, altitudes, azimuths, hoys, sun_pts, analemma, daily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; plug-in component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
merge = Merge(Data1=boundary_surfaces, Data2=cap_holes)  # -> flatten(Result)
gradient = Gradient(
    LowerLimit=number_slider_9,
    UpperLimit=number_slider_10,
    Parameter=remap_numbers.Mapped,
    stops=[0: RGB(255, 255, 255), 1: RGB(0, 0, 0)])  # disabled
legendpar = LBLegendParameters(min=Slider(0, range=0..100), max=Slider(8, range=0..10))  # -> leg_par; plug-in component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
colour_swatch = ColourSwatch(SwatchColor=RGB(255, 255, 255))  # disabled
directsunhours = LBDirectSunHours(
    vectors=flatten(sunpath.vectors),
    geometry=flatten(merge),
    context=flatten(merge),
    grid_size=Slider(5, range=0..10),
    offset_dist=Slider(0.2, range=0..1),
    legend_par=legendpar,
    run=Toggle(False))  # -> out, points, results, mesh, legend, title, int_mtx; plug-in component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
mesh_brep_2 = MeshBrep(
    Brep=boundary_surfaces,
    Settings={GridMaxCount=0, GridMinCount=16, JaggedSeams=False, MaxEdgeLength=0, MinEdgeLength=0.0001, MinTolerance=0, Refine=True, RefineAngle=0, RelativeTolerance=0.65, SimplePlanes=True, Tolerance=0})
mesh_colours = MeshColours(Mesh=mesh_brep_2, Colours=colour_swatch)  # disabled
mesh_colours_2 = MeshColours(Mesh=mesh_join, Colours=gradient)  # disabled
mesh = Mesh(directsunhours.mesh)
